# Grasshopper definition 001_Field_Slope_Edited.gh (Grasshopper 0.9.76)

geo = Geometry(<brep referenced from the Rhino model>)  # disabled
pt = Point(<point referenced from the Rhino model>)  # disabled
panel = Panel("9")  # disabled
srf = Surface(<surface referenced from the Rhino model>)
panel_2 = Panel("8")  # disabled
srf_2 = Surface(<surface referenced from the Rhino model>)  # disabled

# ----
# Right click and select "Set one Surface"
srf_3 = Surface(<surface referenced from the Rhino model>)  # disabled

# ---- group: Parameters
points = Panel("50")  # disabled

# ----
crv = Curve([<curve referenced from the Rhino model> x20])
sdivide = DivideSurface(Surface=srf, UCount=panel, VCount=panel)  # -> Points, Normals, Parameters; disabled
panel_3 = Panel("5")  # disabled
bbox = BoundingBox(Content=srf, Plane=PlaneXY(0, 0, 0))  # -> Box, Box_2; disabled
geo_2 = Geometry()  # disabled
end = EndPoints(Curve=crv)  # -> Start, End

# ---- group: Flat Point Grid
edges = BrepEdges(Brep=srf_3)  # -> Naked, Interior, NonManifold; disabled
end_2 = EndPoints(Curve=edges.Naked)  # -> Start, End; disabled
merge = Merge(Data1=end_2.Start, Data2=end_2.End)  # disabled
cullpt = CullDuplicates(Points=merge, Tolerance=0.1, CullMode=3)  # -> Points, Indices, Valence; disabled
pdecon = Deconstruct(Point=cullpt.Points)  # -> XComponent, YComponent, ZComponent; disabled
pt_2 = ConstructPoint(XCoordinate=pdecon.XComponent, YCoordinate=pdecon.YComponent, ZCoordinate=0)  # disabled
pline = PolyLine(Vertices=pt_2, Closed=True)  # disabled
boundary = BoundarySurfaces(Edges=pline)  # disabled
sdivide_2 = DivideSurface(Surface=boundary, UCount=points, VCount=points)  # -> Points, Normals, Parameters; disabled

# ----
panel_4 = Panel("5")  # disabled
bbox_2 = BoundingBox(Content=srf_2, Plane=PlaneXY(0, 0, 0))  # -> Box, Box_2; disabled
pop3d = Populate3D(Region=bbox.Box, Count=panel_3, Seed=1)  # disabled
merge_2 = Merge(Data1=end.Start, Data2=end.End)

# ---- group: Random Points
bbox_3 = BoundingBox(Content=srf_3, Plane=PlaneXY(0, 0, 0))  # -> Box, Box_2; disabled
pop3d_2 = Populate3D(Region=bbox_3.Box, Count=points, Seed=1)  # disabled

# ----
srf_cp = SurfaceClosestPoint(Point=pop3d, Surface=srf)  # -> Point, UVPoint, Distance; disabled
cullpt_2 = CullDuplicates(Points=merge_2, Tolerance=0.1, CullMode=3)  # -> Points, Indices, Valence
line = LineSDL(Start=cullpt_2.Points, Direction=Vector(0, 0, 1), Length=1)
slx = SurfaceLine(Surface=srf, Line=line, LimitToFirst=False)  # -> Curves, Points, UVPoints, Normal
srf_cp_2 = SurfaceClosestPoint(Point=cullpt_2.Points, Surface=srf)  # -> Point, UVPoint, Distance

pop3d_3 = Populate3D(Region=bbox_2.Box, Count=panel_4, Seed=1)  # disabled
panel_5 = Panel(pop3d_3)  # disabled

line_2 = LineSDL(Start=pop3d_3, Direction=Vector(0, 0, 1), Length=1)  # disabled

srf_cp_3 = SurfaceClosestPoint(Point=pop3d_3, Surface=srf_2)  # -> Point, UVPoint, Distance; disabled
ln = Line(StartPoint=srf_cp_3.Point, EndPoint=pop3d_3)  # disabled

slx_2 = SurfaceLine(Surface=srf_2, Line=line_2, LimitToFirst=False)  # -> Curves, Points, UVPoints, Normal; disabled
panel_6 = Panel(slx_2.Points)  # disabled

cyl = Cylinder(Base=slx.Points, Radius=".5", Length="20")

# ---- group: Straight Intersection
line_3 = LineSDL(Start=pop3d_2, Direction=Vector(0, 0, 1), Length=1)  # disabled
slx_3 = SurfaceLine(Surface=srf_3, Line=line_3, LimitToFirst=False)  # -> Curves, Points, UVPoints, Normal; disabled
ln_2 = Line(StartPoint=graft(pop3d_2), EndPoint=slx_3.Points)  # disabled

# ---- group: Closest Point
srf_cp_4 = SurfaceClosestPoint(Point=pop3d_2, Surface=srf_3)  # -> Point, UVPoint, Distance; disabled
ln_3 = Line(StartPoint=pop3d_2, EndPoint=srf_cp_4.Point)  # disabled

# ----
cyl_2 = Cylinder(Base=sdivide.Points, Radius=".5", Length="20")  # disabled
panel_7 = Panel("2")  # disabled
panel_8 = Panel("6")  # disabled

len = Length(Curve=ln)  # disabled
sph = Sphere(Base=srf_cp_3.Point, Radius=len)  # disabled

vec2pt = Vector2Pt(PointA=pt, Unitize=False)  # -> Vector, Length; disabled
Z = UnitZ(Factor=1)  # disabled
cyl_3 = Cylinder(Base=srf_cp_3.Point, Radius=panel_7, Length=panel_8)  # disabled
move = Move(Motion=vec2pt.Vector)  # -> Geometry, Transform; disabled
orient = OrientDirection(Geometry=geo, PointA=pt, DirectionA=Z, PointB=sdivide.Points, DirectionB=sdivide.Normals)  # -> Geometry, Transform; disabled

# ---- group: Slope_Field
line_4 = LineSDL(Start=sdivide_2.Points, Direction=Vector(0, 0, 1), Length=1)  # -> flatten(Line); disabled
slx_4 = SurfaceLine(Surface=srf_3, Line=line_4, LimitToFirst=False)  # -> Curves, Points, UVPoints, Normal; disabled
evalsrf = EvaluateSurface(Surface=srf_3, Point=slx_4.UVPoints)  # -> Point, Normal, Frame; disabled
line_5 = LineSDL(Start=evalsrf.Point, Direction=evalsrf.Normal, Length=1)  # disabled
project = Project(Curve=line_5, Brep=srf_3, Direction=Vector(0, 0, 1))  # disabled
panel_9 = Panel("2")  # disabled
end_3 = EndPoints(Curve=project)  # -> Start, End; disabled
vec2pt_2 = Vector2Pt(PointA=end_3.Start, PointB=end_3.End, Unitize=False)  # -> Vector, Length; disabled
unit = UnitVector(Vector=vec2pt_2.Vector)  # disabled
circle = CircleCNR(Center=evalsrf.Point, Normal=evalsrf.Normal, Radius=expr("x/10", panel_9))  # disabled
line_6 = LineSDL(Start=evalsrf.Point, Direction=unit, Length=panel_9)  # disabled

# ----
graft = GraftTree(Tree=pop3d_3, IncludeEmptyLists=True, IncludeNullItems=True)  # disabled
panel_10 = Panel(graft)  # disabled

flatten = FlattenTree(Tree=slx_2.Points, Path="{0}")  # disabled
panel_11 = Panel(flatten)  # disabled

ln_4 = Line(StartPoint=flatten, EndPoint=pop3d_3)  # disabled
