# Grasshopper definition 002_Field_Binary.gh (Grasshopper 0.9.76)

# ---- group: Parameters
points = Panel("25")

# ---- group: Input
srf = Surface(<surface referenced from the Rhino model>)

# ---- group: Flat Point Grid
edges = BrepEdges(Brep=srf)  # -> Naked, Interior, NonManifold
end = EndPoints(Curve=edges.Naked)  # -> Start, End
merge = Merge(Data1=end.Start, Data2=end.End)
cullpt = CullDuplicates(Points=merge, Tolerance=0.1, CullMode=3)  # -> Points, Indices, Valence
pdecon = Deconstruct(Point=cullpt.Points)  # -> XComponent, YComponent, ZComponent
pt = ConstructPoint(XCoordinate=pdecon.XComponent, YCoordinate=pdecon.YComponent, ZCoordinate=0)
pline = PolyLine(Vertices=pt, Closed=True)
boundary = BoundarySurfaces(Edges=pline)
sdivide = DivideSurface(Surface=boundary, UCount=points, VCount=points)  # -> Points, Normals, Parameters

# ---- group: Point On Surface
line = LineSDL(Start=sdivide.Points, Direction=Vector(0, 0, 1), Length=1)
slx = SurfaceLine(Surface=srf, Line=line, LimitToFirst=False)  # -> Curves, simplify(Points), UVPoints, Normal
path_mapper = PathMapper(slx.Points, source="{A;B}", target="{A}")

# ---- group: Binary Pattern
bool = Boolean([True, False, False])
box = CenterBox(Base=path_mapper, X=1, Y=1, Z=1)
dispatch = Dispatch(List=box, DispatchPattern=bool)  # -> ListA, ListB
dispatch_2 = Dispatch(List=path_mapper, DispatchPattern=bool)  # -> ListA, ListB
scale_nu = ScaleNU(Geometry=dispatch.ListA, Plane=dispatch_2.ListA, ScaleX=1, ScaleY=1, ScaleZ=3)  # -> Geometry, Transform
weave = Weave(Pattern=bool, Stream0=dispatch.ListB, Stream1=scale_nu.Geometry, NullGaps=False)
flip = FlipMatrix(Data=weave)
flip_2 = FlipMatrix(Data=path_mapper)
dispatch_3 = Dispatch(List=flip, DispatchPattern=bool)  # -> ListA, ListB
dispatch_4 = Dispatch(List=flip_2, DispatchPattern=bool)  # -> ListA, ListB
scale_nu_2 = ScaleNU(Geometry=dispatch_3.ListA, Plane=dispatch_4.ListA, ScaleX=1, ScaleY=1, ScaleZ=3)  # -> Geometry, Transform
weave_2 = Weave(Pattern=bool, Stream0=dispatch_3.ListB, Stream1=scale_nu_2.Geometry, NullGaps=False)
