# Grasshopper definition 003_Field_Attractors.gh (Grasshopper 0.9.76)

# ---- group: Input
pt_negative = Point([<point referenced from the Rhino model> x3])
pt_positive = Point([<point referenced from the Rhino model> x3])
srf = Surface(<surface referenced from the Rhino model>)

# ---- group: Parameters
points = Panel("25")

# ---- group: Flat Point Grid
edges = BrepEdges(Brep=srf)  # -> Naked, Interior, NonManifold
end = EndPoints(Curve=edges.Naked)  # -> Start, End
merge = Merge(Data1=end.Start, Data2=end.End)
cullpt = CullDuplicates(Points=merge, Tolerance=0.1, CullMode=3)  # -> Points, Indices, Valence
pdecon = Deconstruct(Point=cullpt.Points)  # -> XComponent, YComponent, ZComponent
pt = ConstructPoint(XCoordinate=pdecon.XComponent, YCoordinate=pdecon.YComponent, ZCoordinate=0)
pline = PolyLine(Vertices=pt, Closed=True)
boundary = BoundarySurfaces(Edges=pline)
sdivide = DivideSurface(Surface=boundary, UCount=points, VCount=points)  # -> flatten(Points), Normals, Parameters

# ----
graft = GraftTree(Tree=sdivide.Points, IncludeEmptyLists=True, IncludeNullItems=True)
vec2pt = Vector2Pt(PointA=graft, PointB=pt_positive, Unitize=False)  # -> Vector, Length
vec2pt_2 = Vector2Pt(PointA=pt_negative, PointB=graft, Unitize=False)  # -> Vector, Length
unit = UnitVector(Vector=vec2pt.Vector)
unit_2 = UnitVector(Vector=vec2pt_2.Vector)
one_over_x = OneOverX(Value=vec2pt.Length)
one_over_x_2 = OneOverX(Value=vec2pt_2.Length)
amp = Amplitude(Vector=unit, Amplitude=one_over_x)
amp_2 = Amplitude(Vector=unit_2, Amplitude=one_over_x_2)
merge_2 = Merge(Data1=amp, Data2=amp_2)
sort = SortList(Keys=vec2pt.Length)  # -> Keys, ValuesA
sort_2 = SortList(Keys=vec2pt_2.Length)  # -> Keys, ValuesA
avr = Average(Input=merge_2)
item = ListItem(List=sort.Keys, Index=0, Wrap=True)
item_2 = ListItem(List=sort_2.Keys, Index=0, Wrap=True)
line = LineSDL(Start=graft, Direction=avr, Length=1)
smaller = SmallerThan(FirstNumber=item, SecondNumber=item_2)  # -> SmallerThan, OrEqualTo
dispatch = Dispatch(List=line, DispatchPattern=smaller.SmallerThan)  # -> ListA, ListB
preview = CustomPreview(Geometry=dispatch.ListB, Shader=ColourSwatch(SwatchColor=RGB(0, 251, 255)))
preview_2 = CustomPreview(Geometry=dispatch.ListA, Shader=ColourSwatch(SwatchColor=RGB(255, 0, 0)))

srf_2 = Surface()
srf_cp = SurfaceClosestPoint(Point=sdivide.Points, Surface=srf)  # -> Point, UVPoint, Distance
cyl = Cylinder(Base=srf_cp.Point, Radius=0.25, Length=8)
