# Grasshopper definition 004_Field_Path.gh (Grasshopper 0.9.76)

# ---- group: Parameters
points = Panel("25")

# ---- group: Input
srf = Surface(<surface referenced from the Rhino model>)
crv = Curve([<curve referenced from the Rhino model> x4])

# ---- group: Flat Point Grid
edges = BrepEdges(Brep=srf)  # -> Naked, Interior, NonManifold
end = EndPoints(Curve=edges.Naked)  # -> Start, End
merge = Merge(Data1=end.Start, Data2=end.End)
cullpt = CullDuplicates(Points=merge, Tolerance=0.1, CullMode=3)  # -> Points, Indices, Valence
pdecon = Deconstruct(Point=cullpt.Points)  # -> XComponent, YComponent, ZComponent
pt = ConstructPoint(XCoordinate=pdecon.XComponent, YCoordinate=pdecon.YComponent, ZCoordinate=0)
pline = PolyLine(Vertices=pt, Closed=True)
boundary = BoundarySurfaces(Edges=pline)
sdivide = DivideSurface(Surface=boundary, UCount=points, VCount=points)  # -> flatten(Points), Normals, Parameters

# ---- group: Path Field
graft = GraftTree(Tree=sdivide.Points, IncludeEmptyLists=True, IncludeNullItems=True)
crv_cp = CurveClosestPoint(Point=graft, Curve=crv)  # -> Point, Parameter, Distance
vec2pt = Vector2Pt(PointA=graft, PointB=crv_cp.Point, Unitize=False)  # -> Vector, Length
one_over_x = OneOverX(Value=crv_cp.Distance)
unit = UnitVector(Vector=vec2pt.Vector)
amp = Amplitude(Vector=unit, Amplitude=one_over_x)
avr = Average(Input=amp)
line = LineSDL(Start=graft, Direction=avr, Length=1)

# ---- group: Color
lng = ListLength(List=crv)
range = Range(Domain=Domain(0, 1), Steps=expr("x-1", lng))
gradient = Gradient(
    LowerLimit=0,
    UpperLimit=1,
    Parameter=range,
    stops=[0: RGB(234, 38, 0), 0.25: RGB(234, 126, 0), 0.5: RGB(254, 244, 84), 0.75: RGB(173, 203, 249), 1: RGB(75, 107, 169)])
sort = SortList(Keys=crv_cp.Distance, ValuesA=gradient)  # -> Keys, ValuesA
item = ListItem(List=sort.ValuesA, Index=0, Wrap=True)
preview = CustomPreview(Geometry=line, Shader=item)
