# Grasshopper definition 004_Graft_Example.gh (Grasshopper 0.9.76)

number_slider = Slider(10, range=0..10)
srf = Surface(<surface referenced from the Rhino model>)
merge = Merge(Data1="3", Data2="2", Data3="2")
graft = GraftTree(Tree=["1", "2"], IncludeEmptyLists=True, IncludeNullItems=True)
panel = Panel(graft)
series = Series(Start=0, Step=merge, Count=["3", "4"])  # -> simplify(Series)
sdivide = DivideSurface(Surface=srf, UCount=number_slider, VCount=Slider(10, range=0..10))  # -> Points, Normals, Parameters
item = ListItem(List=series, Index=graft, Wrap=True)
panel_2 = Panel(series)
panel_3 = Panel(item)
series_2 = Series(Start=0, Step="2", Count=number_slider)  # -> graft(Series)
panel_4 = Panel(series_2)
flip = FlipMatrix(Data=sdivide.Points)
srf_2 = Surface([<surface referenced from the Rhino model> x3])
item_2 = ListItem(List=flip, Index=series_2, Wrap=True)
panel_5 = Panel(srf_2)
pt = Point([<point referenced from the Rhino model> x3])
sph = Sphere(Base=item_2, Radius=10)
graft_2 = GraftTree(Tree=srf_2, IncludeEmptyLists=True, IncludeNullItems=True)  # -> simplify(Tree)
panel_6 = Panel(graft_2)
srf_cp = SurfaceClosestPoint(Point=pt, Surface=graft_2)  # -> Point, UVPoint, Distance
panel_7 = Panel(srf_cp.Point)
box = CenterBox(Base=srf_cp.Point, X="10", Y="10", Z="10")
flip_2 = FlipMatrix(Data=box)
panel_8 = Panel(flip_2)
panel_9 = Panel(box)
item_3 = ListItem(List=flip_2, Index=0, Wrap=True)
item_4 = ListItem(List=box, Index=0, Wrap=True)
preview = CustomPreview(
    Geometry=item_3,
    Shader={ambient=RGB(0, 0, 0), diffuse=RGB(255, 105, 180), emission=RGB(76, 32, 54), shine=0.5, specular=RGB(255, 255, 255), transparency=0})
preview_2 = CustomPreview(Geometry=item_4, Shader=ColourSwatch(SwatchColor=RGB(255, 255, 255)))
