# Grasshopper definition 004_Handrail.gh (Grasshopper 0.9.76)

number_slider = Slider(10, range=0..10)
number_slider_2 = Slider(22, range=0..100)
number_slider_3 = Slider(0.33, range=0..1)
number_slider_4 = Slider(10, range=0..10)
crv = Curve(<curve referenced from the Rhino model>)
srf = Surface(<surface referenced from the Rhino model>)
project = Project(Curve=crv, Brep=srf, Direction=Vector(0, 0, 1))
offsets = OffsetOnSrf(Curve=project, Distance=expr("-x", number_slider_4), Surface=srf)
offsets_2 = OffsetOnSrf(Curve=project, Distance=number_slider_4, Surface=srf)

# ---- group: handrail
divide = DivideCurve(Curve=offsets_2, Count=number_slider_2, Kinks=False)  # -> Points, Tangents, Parameters
Z = UnitZ(Factor=number_slider)
move = Move(Geometry=offsets_2, Motion=Z)  # -> Geometry, Transform
cyl = Cylinder(Base=divide.Points, Radius=number_slider_3, Length=number_slider)
multiplication = Multiplication(A=number_slider_3, B="2")
pipe = Pipe(Curve=move.Geometry, Radius=multiplication, Caps=0)
preview = CustomPreview(
    Geometry=[cyl, pipe],
    Shader={ambient=RGB(0, 0, 0), diffuse=RGB(255, 105, 180), emission=RGB(76, 32, 54), shine=0.5, specular=RGB(255, 255, 255), transparency=0})

divide_2 = DivideCurve(Curve=offsets, Count=number_slider_2, Kinks=False)  # -> Points, Tangents, Parameters
Z_2 = UnitZ(Factor=number_slider)
move_2 = Move(Geometry=offsets, Motion=Z_2)  # -> Geometry, Transform
cyl_2 = Cylinder(Base=divide_2.Points, Radius=number_slider_3, Length=number_slider)
multiplication_2 = Multiplication(A=number_slider_3, B="2")
pipe_2 = Pipe(Curve=move_2.Geometry, Radius=multiplication_2, Caps=0)
preview_2 = CustomPreview(
    Geometry=[cyl_2, pipe_2],
    Shader={ambient=RGB(0, 0, 0), diffuse=RGB(255, 105, 180), emission=RGB(76, 32, 54), shine=0.5, specular=RGB(255, 255, 255), transparency=0})

# ----
brep = Brep([pipe, cyl, pipe_2, cyl_2])
