# Grasshopper definition Tree_Generator.gh (Grasshopper 0.9.76)

pt = Point(<point referenced from the Rhino model>)

# ---- group: cull_example
series = Series(Start=0, Step=1, Count=10)
panel = Panel(series)
merge = Merge(Data1="1", Data2="0", Data3="0")
cull = CullPattern(List=series, CullPattern=merge)
panel_2 = Panel(cull)

# ---- group: Parameters
points = Panel("25")

# ----
# Right click and select "Set one Surface"
srf = Surface(<surface referenced from the Rhino model>)

brep = Brep(<brep referenced from the Rhino model>)
geo = Geometry(<brep referenced from the Rhino model>)
crv = Curve(<curve referenced from the Rhino model>)
crv_2 = Curve(<curve referenced from the Rhino model>)
trigrid = Triangular(Plane=pt, Size="5", ExtentX="100", ExtentY="100")  # -> flatten(Cells), Points
sqgrid = Square(Plane=pt, Size="5", ExtentX="100", ExtentY="100")  # -> Cells, Points
merge_2 = Merge(Data1=crv, Data2=crv_2)
project = Project(Curve=trigrid.Cells, Brep=srf, Direction=Vector(0, 0, 1))  # -> flatten(Curve)
project_2 = Project(Curve=sqgrid.Cells, Brep=srf, Direction=Vector(0, 0, 1))
curvepoint = PointOnCurve(project, parameter=0.524)

incurve = PointInCurve(Point=curvepoint, Curve=crv)  # -> Relationship, Point
brepinc = PointInBrep(Brep=brep, Point=curvepoint, Strict=False)
incurves = PointInCurves(Point=curvepoint, Curves=[crv, crv_2])  # -> Relationship, Index, Point

end = EndPoints(Curve=project)  # -> Start, End

# ---- group: cull v dispatch
dispatch = Dispatch(List=curvepoint, DispatchPattern=incurve.Relationship)  # -> ListA, ListB
cull_2 = CullPattern(List=curvepoint, CullPattern=incurve.Relationship)
pt_2 = Point(flatten(dispatch.ListA))
pt_3 = Point(dispatch.ListB)

# ----
dispatch_2 = Dispatch(List=curvepoint, DispatchPattern=brepinc)  # -> ListA, ListB
cull_3 = CullPattern(List=curvepoint, CullPattern=brepinc)
pt_4 = Point(dispatch_2.ListA)
pt_5 = Point(dispatch_2.ListB)

# ---- group: random_tree generator
cullpt = CullDuplicates(Points=pt_2, Tolerance=0.1, CullMode=3)  # -> Points, Indices, Valence
pt_6 = Point(cullpt.Points)
lng = ListLength(List=pt_6)
dom = ConstructDomain(DomainStart="5", DomainEnd="10")
dom_2 = ConstructDomain(DomainStart=".25", DomainEnd=".5")
dom_3 = ConstructDomain(DomainStart="1", DomainEnd="2")
random = Random(Range=dom, Number=lng, Seed="3")
random_2 = Random(Range=dom_2, Number=lng, Seed="2")
random_3 = Random(Range=dom_3, Number=lng, Seed="3")
Z = UnitZ(Factor=random)
move = Move(Geometry=pt_6, Motion=Z)  # -> Geometry, Transform
cyl = Cylinder(Base=pt_6, Radius=random_2, Length=random)
sph = Sphere(Base=move.Geometry, Radius=random_3)

# ----
sdivide = DivideSurface(Surface=srf, UCount=points, VCount=points)  # -> Points, Normals, Parameters; disabled

# ---- group: Slope_Field
line = LineSDL(Start=sdivide.Points, Direction=Vector(0, 0, 1), Length=1)  # -> flatten(Line); disabled
slx = SurfaceLine(Surface=srf, Line=line, LimitToFirst=False)  # -> Curves, Points, UVPoints, Normal; disabled
evalsrf = EvaluateSurface(Surface=srf, Point=slx.UVPoints)  # -> Point, Normal, Frame; disabled
line_2 = LineSDL(Start=evalsrf.Point, Direction=evalsrf.Normal, Length=1)  # disabled
project_3 = Project(Curve=line_2, Brep=srf, Direction=Vector(0, 0, 1))  # disabled
panel_3 = Panel("2")  # disabled
end_2 = EndPoints(Curve=project_3)  # -> Start, End; disabled
vec2pt = Vector2Pt(PointA=end_2.Start, PointB=end_2.End, Unitize=False)  # -> Vector, Length; disabled
unit = UnitVector(Vector=vec2pt.Vector)  # disabled
circle = CircleCNR(Center=evalsrf.Point, Normal=evalsrf.Normal, Radius=expr("x/10", panel_3))  # disabled
line_3 = LineSDL(Start=evalsrf.Point, Direction=unit, Length=panel_3)  # disabled
