# Grasshopper definition Tree_Generator_Advanced.gh (Grasshopper 0.9.76)

srf = Surface(<surface referenced from the Rhino model>)

xy = XYPlane(Origin=Point(0, 0, 0))
Z = UnitZ(Factor="100")
crv = Curve(<curve referenced from the Rhino model>)
extr = Extrude(Base=crv, Direction=Z)
Z_2 = UnitZ(Factor="10")
move = Move(Geometry=xy, Motion=Z_2)  # -> Geometry, Transform
sec = BrepPlane(Brep=extr, Plane=move.Geometry)  # -> Curves, Points
split = SplitBrep(Brep=extr, Cutter=sec.Curves)  # -> graft(Result)

# ---- group: topography_beds
xy_2 = XYPlane(Origin=Point(0, 0, 0))
Z_3 = UnitZ(Factor="3")
move_2 = Move(Geometry=xy_2, Motion=Z_3)  # -> Geometry, Transform
sec_2 = BrepPlane(Brep=srf, Plane=move_2.Geometry)  # -> Curves, Points

# ---- group: project_joined_path
crv_2 = Curve(<curve referenced from the Rhino model>)
project = Project(Curve=crv_2, Brep=srf, Direction=Vector(0, 0, 1))
offsets = OffsetOnSrf(Curve=project, Distance="4", Surface=srf)
end = EndPoints(Curve=offsets)  # -> Start, End
end_2 = EndPoints(Curve=project)  # -> Start, End
ln = Line(StartPoint=end.Start, EndPoint=end_2.Start)
ln_2 = Line(StartPoint=end.End, EndPoint=end_2.End)
merge = Merge(Data1=offsets, Data2=ln, Data3=ln_2, Data4=project)  # -> flatten(Result)
join = JoinCurves(Curves=merge, Preserve=False)

# ----
srf_2 = Surface(<surface referenced from the Rhino model>)
series = Series(Start=0, Step=2, Count=11)
sdivide = DivideSurface(Surface=srf_2, UCount="25", VCount="25")  # -> flatten(Points), Normals, Parameters
panel = Panel(series)
pdecon = Deconstruct(Point=sdivide.Points)  # -> XComponent, YComponent, ZComponent
bnd = Bounds(Numbers=panel)

# ---- group: remapping
bnd_2 = Bounds(Numbers=pdecon.ZComponent)
remap = RemapNumbers(Value=pdecon.ZComponent, Source=bnd_2, Target=Domain(0, 1))  # -> Mapped, Clipped

# ----
panel_2 = Panel(bnd)
remap_2 = RemapNumbers(Value=panel, Source=bnd, Target=Domain(0, 1))  # -> Mapped, Clipped

# ---- group: center_point
debrep = DeconstructBrep(Brep=split)  # -> Faces, Edges, Vertices
avr = Average(Input=debrep.Vertices)  # -> flatten(ArithmeticMean)

# ----
dom = ConstructDomain(DomainStart="5", DomainEnd="20")

# ---- group: remapping
bnd_3 = Bounds(Numbers=pdecon.ZComponent)
remap_3 = RemapNumbers(Value=pdecon.ZComponent, Source=bnd_3, Target=dom)  # -> Mapped, Clipped

# ----
graph = GraphMapper(remap.Mapped, x0=0, x1=1, y0=0, y1=1, container_name="Bezier", cpx=[0, 0.7681159377, 0.2391304374, 1], cpy=[0, 0, 1, 1])
panel_3 = Panel(graph)

pdecon_2 = Deconstruct(Point=avr)  # -> XComponent, YComponent, ZComponent
sort = SortList(Keys=flatten(pdecon_2.ZComponent), ValuesA=flatten(split), ValuesB=flatten(avr))  # -> reverse(Keys), ValuesA, reverse(ValuesB)
item = ListItem(List=sort.ValuesA, Index=0, Wrap=True)
item_2 = ListItem(List=sort.ValuesB, Index=0, Wrap=True)

cyl = Cylinder(Base=sdivide.Points, Radius=graph, Length=remap_3.Mapped)

sdivide_2 = DivideSurface(Surface=srf, UCount="40", VCount="40")  # -> Points, Normals, Parameters
incurves = PointInCurves(Point=sdivide_2.Points, Curves=sec_2.Curves)  # -> Relationship, Index, Point

dispatch = Dispatch(List=sdivide_2.Points, DispatchPattern=incurves.Relationship)  # -> ListA, ListB
pt = Point(dispatch.ListB)

pt_2 = Point(dispatch.ListA)

# ---- group: random_pts
jitter = Jitter(List=flatten(pt_2), Jitter=1, Seed=2)  # -> Values, Indices
lng = ListLength(List=jitter.Values)
multiplication = Multiplication(A=lng, B=Slider(0.446, range=0..1))
split_2 = SplitList(List=jitter.Values, Index=multiplication)  # -> ListA, ListB

# ---- group: random_tree generator
cullpt = CullDuplicates(Points=flatten(split_2.ListA), Tolerance=0.1, CullMode=3)  # -> Points, Indices, Valence
pt_3 = Point(cullpt.Points)
lng_2 = ListLength(List=pt_3)
dom_2 = ConstructDomain(DomainStart="5", DomainEnd="10")
dom_3 = ConstructDomain(DomainStart=".25", DomainEnd=".5")
dom_4 = ConstructDomain(DomainStart="1", DomainEnd="2")
random = Random(Range=dom_2, Number=lng_2, Seed="3")
random_2 = Random(Range=dom_3, Number=lng_2, Seed="2")
random_3 = Random(Range=dom_4, Number=lng_2, Seed="3")
Z_4 = UnitZ(Factor=random)
move_3 = Move(Geometry=pt_3, Motion=Z_4)  # -> Geometry, Transform
cyl_2 = Cylinder(Base=pt_3, Radius=random_2, Length=random)
sph = Sphere(Base=move_3.Geometry, Radius=random_3)

# ---- group: flowers
box = CenterBox(Base=pt, X=".2", Y=".2", Z=".2")
